# Dynamo graph test.dyn (Dynamo 0.8.0.950)

code_block = CodeBlock { Autodesk.Point.ByCoordinates(0,0,0); Autodesk.Point.ByCoordinates(0,50,0); 3.0; 8; }
createMeshBarFromPoints = DynamoMeshBar.DynamoMeshBar.CreateMeshBarFromPoints(code_block.out0, code_block.out1, code_block.out2, code_block.out3)
