# Dynamo graph test_DirectShape_2016.dyn (Dynamo 0.8.0.950)

current = Document.Current()
code_block = CodeBlock { Autodesk.Point.ByCoordinates(0,0,0); Autodesk.Point.ByCoordinates(0,50,0); 3.0; 8; }
createMeshBarFromPoints = DynamoMeshBar.DynamoMeshBar.CreateMeshBarFromPoints(code_block.out0, code_block.out1, code_block.out2, code_block.out3)
code_block_2 = CodeBlock { "test direct shape"; }
newDirectShape = DynamoMeshBar.DirectShapeFromDSMesh.NewDirectShape(createMeshBarFromPoints, code_block_2)
watch = Watch(newDirectShape)
