# Dynamo graph test_rect.dyn (Dynamo 0.8.0.950)

createMeshBarFromPoints = DynamoMeshBar.DynamoMeshBar.CreateMeshBarFromPoints()
create = List.Create()
number_slider = DoubleSlider(50, range=0..100 step 0.1)
code_block = CodeBlock(x=number_slider)
# ---------- code_block.designscript (12 lines) ----------
x;
a = Autodesk.Point.ByCoordinates(0,0,0);
b = Autodesk.Point.ByCoordinates(0,x,0);
c = Autodesk.Point.ByCoordinates(x,x,0);
d = Autodesk.Point.ByCoordinates(x,0,0);
3.0;
8;
e = IndexGroup.ByIndices(0,1,2);
f = IndexGroup.ByIndices(2,3,0);
{a,b,c,d};
{e,f};
"blah";
# ----------------------------------------
byPointsFaceIndices = Mesh.ByPointsFaceIndices(code_block.out9, code_block.out10)
newDirectShape = DynamoMeshBar.DirectShapeFromDSMesh.NewDirectShape(byPointsFaceIndices, code_block.out11)
